# Grasshopper definition Adaptive WIndow.gh (Grasshopper 1.0.7)

frame_height = Slider(903, range=0..1200)
frame_width = Slider(1075, range=0..1600)
window_width = GetNumber(frame_width, AtLeast=1, AtMost=1, Maximum=1.797693135e+308, Minimum=-1.797693135e+308, TreeAccess=False)
window_height = GetNumber(frame_height, AtLeast=1, AtMost=1, Maximum=1.797693135e+308, Minimum=-1.797693135e+308, TreeAccess=False)
get_integer = GetInteger(Slider(3, range=0..10), AtLeast=1, AtMost=1, Maximum=2147483647, Minimum=-2147483648, TreeAccess=False)

door_frame_seal_gap_top_bottom = Slider(2, range=0..10)
window_frame_depth_1_sides = Slider(40.5, range=0..100)
window_frame_depth_2_top_b = Slider(48.5, range=0..100)
glass_frame_wedge_seal_gap = Slider(3, range=0..10)
door_frame_seal_gap_side = Slider(2.7, range=0..10)
glass_frame_clearance = Slider(3, range=0..10)
door_to_door_gap = Slider(3.4, range=0..10)
inner_face_seal_gap = Slider(0, range=0..10)
glass_frame_inset = Slider(10, range=0..20)
glass_thickness = Slider(16, range=0..25)

door_jam_recess_x = Slider(10, range=0..100)
door_jam_recess_x_2 = Slider(19.8, range=0..100)
door_jam_recess_y = Slider(41.4, range=0..50)
door_jam_recess_y_2 = Slider(17, range=0..50)
door_jam_x = Slider(45.4, range=0..100)
door_jam_y = Slider(101.5, range=0..250)
subtraction = Subtraction(A=door_jam_x, B=door_jam_recess_x_2)

# ---- group: DOOR JAM
expression = Expression(x=window_width, Expression="x/2")
expression_2 = Expression(x=door_jam_y, Expression="x/2")
expression_3 = Expression(x=door_jam_recess_y, Expression="x/2")
expression_4 = Expression(x=door_jam_recess_y_2, Expression="x/2")
num = Number(subtraction)
expression_5 = Expression(x=expression, y=num, Expression="-x+y")
expression_6 = Expression(x=expression_2, y=expression_4, Expression="(x-y)")
expression_7 = Expression(x=expression, y=num, Expression="-x+y")
expression_8 = Expression(x=expression_2, y=expression_3, Expression="-(x-y)")
pt = ConstructPoint(XCoordinate=expression_5, YCoordinate=expression_6, ZCoordinate=0)
dom = ConstructDomain(DomainStart=expr("-x", expression_4), DomainEnd=expression_4)
dom_2 = ConstructDomain(DomainStart=0, DomainEnd=expr("-x", door_jam_recess_x))
pt_2 = ConstructPoint(XCoordinate=expr("-x", expression), YCoordinate=0, ZCoordinate=0)
dom_3 = ConstructDomain(DomainStart=expr("-x", expression_3), DomainEnd=expression_3)
dom_4 = ConstructDomain(DomainStart=expr("-x", expression_2), DomainEnd=expression_2)
pt_3 = ConstructPoint(XCoordinate=expression_7, YCoordinate=expression_8, ZCoordinate=0)
xy = XYPlane(Origin=pt)
xy_2 = XYPlane(Origin=pt_2)
xy_3 = XYPlane(Origin=pt_3)
rectangle = Rectangle(Plane=xy_3, XSize=door_jam_recess_x_2, YSize=dom_3, Radius=0)  # -> Rectangle, Length
rectangle_2 = Rectangle(Plane=xy_2, XSize=num, YSize=dom_4, Radius=0)  # -> Rectangle, Length
rectangle_3 = Rectangle(Plane=xy, XSize=dom_2, YSize=dom, Radius=0)  # -> Rectangle, Length
runion = RegionUnion(Curves=[rectangle_2.Rectangle, rectangle.Rectangle])
rdiff = RegionDifference(CurvesA=runion, CurvesB=rectangle_3.Rectangle)

# ---- group: SEAL GROOVE
crv = Curve(rdiff)
disc = Discontinuity(Curve=crv, Level=1)  # -> Points, Parameters
points = PointList(Points=disc.Points, Size=10)
item = ListItem(List=disc.Points, Index=3, Wrap=True)
xy_4 = XYPlane(Origin=item)
neg = Negative(Value=Slider(5, range=0..10))
rectangle_4 = Rectangle(Plane=xy_4, XSize=neg, YSize=Slider(3, range=0..10), Radius=0)  # -> Rectangle, Length

# ---- group: FRAME PROFILE
rdiff_2 = RegionDifference(CurvesA=crv, CurvesB=rectangle_4.Rectangle)

# ---- group: ROTATE PROFILE CURVE FOR TOP / BOTTOM
pt_4 = ConstructPoint(XCoordinate=expr("-x", expression), YCoordinate=0, ZCoordinate=0)
xz = XZPlane(Origin=pt_4)
rotate = Rotate(Geometry=rdiff_2, Angle=-1.570796327, Plane=xz)  # -> Geometry, Transform
Z = UnitZ(Factor=window_height)
move = Move(Geometry=rotate.Geometry, Motion=Z)  # -> Geometry, Transform

# ---- group: FRAME PROFILE
expression_9 = Expression(x=num, y=door_jam_recess_x, Expression="(x-y)")
crv_2 = Curve(rdiff_2)
expression_10 = Expression(x=window_height, y=expression_9, Expression="x-y")
Z_2 = UnitZ(Factor=expression_10)
extr = Extrude(Base=crv_2, Direction=Z_2)
cap = CapHoles(Brep=extr)

# ----
X = UnitX(Factor=window_width)
crv_3 = Curve(move.Geometry)
extr_2 = Extrude(Base=crv_3, Direction=X)

# ---- group: FRAME
expression_11 = Expression(x=num, y=door_jam_recess_x_2, Expression="(x+y)")
expression_12 = Expression(x=num, y=door_jam_recess_x, z=expression, Expression="z-x+y")
expression_13 = Expression(x=window_height, y=expression_11, Expression="x-y")
expression_14 = Expression(x=expression, y=expression_11, Expression="x-y")
expression_15 = Expression(x=window_height, y=expression_11, z=door_jam_recess_x_2, Expression="x-y+z")
pt_5 = ConstructPoint(XCoordinate=expr("-x", expression_14), YCoordinate=0, ZCoordinate=expression_13)
number_slider = Slider(77, range=0..100)
pt_6 = ConstructPoint(XCoordinate=expr("-x", expression), YCoordinate=0, ZCoordinate=expression_10)
pt_7 = ConstructPoint(XCoordinate=expr("-x", expression_12), YCoordinate=0, ZCoordinate=expression_10)
pt_8 = ConstructPoint(XCoordinate=expr("-x", expression_12), YCoordinate=0, ZCoordinate=expression_15)
pt_9 = ConstructPoint(XCoordinate=expr("-x", expression_14), YCoordinate=0, ZCoordinate=expression_15)
pdecon = Deconstruct(Point=pt_9)  # -> XComponent, YComponent, ZComponent
merge = Merge(Data1=pt_6, Data2=pt_7, Data3=pt_8, Data4=pt_9, Data5=pt_5)
vec = VectorXYZ(XComponent=-1, YComponent=0, ZComponent=-1)  # -> Vector, Length
vec_2 = VectorXYZ(XComponent=number_slider, YComponent=0, ZComponent=number_slider)  # -> Vector, Length
arc = ArcSED(Start=pt_6, End=pt_5, Direction=vec.Vector)  # -> Arc, Plane, Radius
deplane = DeconstructPlane(Plane=arc.Plane)  # -> Origin, XAxis, YAxis, ZAxis
pline = PolyLine(Vertices=merge, Closed=False)
expression_16 = Expression(x=door_jam_y, Expression="(x/2)+20")
move_2 = Move(Geometry=deplane.Origin, Motion=vec_2.Vector)  # -> Geometry, Transform
arc_2 = ArcSED(Start=pt_6, End=pt_5, Direction=vec.Vector)  # -> Arc, Plane, Radius
arc_3 = Arc3Pt(PointA=pt_6, PointB=move_2.Geometry, PointC=pt_5)  # -> Arc, Plane, Radius
neg_2 = Negative(Value=expression_16)
join = JoinCurves(Curves=[pline, arc_2.Arc], Preserve=False)
expression_17 = Expression(x=window_height, Expression="x/2")
join_2 = JoinCurves(Curves=[pline, arc_3.Arc], Preserve=False)
Y = UnitY(Factor=[neg_2, expression_16])
pt_10 = ConstructPoint(XCoordinate=0, YCoordinate=0, ZCoordinate=expression_17)
extr_3 = Extrude(Base=join, Direction=Y)
extr_4 = Extrude(Base=join_2, Direction=Y)
join_3 = BrepJoin(Breps=extr_3)  # -> Breps, Closed
join_4 = BrepJoin(Breps=extr_4)  # -> Breps, Closed
yz = YZPlane(Origin=Point(0, 0, 0))
xy_5 = XYPlane(Origin=pt_10)
cap_2 = CapHoles(Brep=join_3.Breps)
cap_3 = CapHoles(Brep=join_4.Breps)
mirror = Mirror(Geometry=cap_2, Plane=yz)  # -> Geometry, Transform
cap_4 = CapHoles(Brep=extr_2)
sdiff = SolidDifference(BrepsA=cap_4, BrepsB=cap_2)
mirror_2 = Mirror(Geometry=cap_3, Plane=xy_5)  # -> Geometry, Transform
sdiff_2 = SolidDifference(BrepsA=cap, BrepsB=cap_3)
yz_2 = YZPlane(Origin=Point(0, 0, 0))
sdiff_3 = SolidDifference(BrepsA=sdiff_2, BrepsB=mirror_2.Geometry)
mirror_3 = Mirror(Geometry=sdiff_3, Plane=yz_2)  # -> Geometry, Transform
sdiff_4 = SolidDifference(BrepsA=sdiff, BrepsB=mirror.Geometry)
mirror_4 = Mirror(Geometry=sdiff_4, Plane=xy_5)  # -> Geometry, Transform

# ---- group: WINDOWS
expression_18 = Expression(x=window_height, y=num, z=door_frame_seal_gap_top_bottom, Expression="x-2*y-2*z")
expression_19 = Expression(x=window_width, y=num, Expression="x-2*y")
expression_20 = Expression(
    x=expression_19,
    Seal_Gap=door_frame_seal_gap_side,
    W_Gap=door_to_door_gap,
    panes=get_integer,
    Expression="(x-(2*Seal_Gap+3*W_Gap))/panes")
pt_11 = ConstructPoint(XCoordinate=expr("-x", expression), YCoordinate=0, ZCoordinate=0)
expression_21 = Expression(x=expression_18, WF_Depth=window_frame_depth_2_top_b, Expression="(x-2*WF_Depth)/2")
expression_22 = Expression(x=expression_20, WF_Depth=window_frame_depth_1_sides, Expression="(x-2*WF_Depth)/2")
xz_2 = XZPlane(Origin=pt_11)
rectangle_5 = Rectangle(Plane=xz_2, XSize=expression_20, YSize=expression_18, Radius=0)  # -> Rectangle, Length
addition = Addition(A=num, B=door_frame_seal_gap_top_bottom)
addition_2 = Addition(A=num, B=door_frame_seal_gap_side)
expression_23 = Expression(
    w=door_jam_y,
    y1=door_jam_recess_y,
    y2=door_jam_recess_y_2,
    g=inner_face_seal_gap,
    Gls=glass_thickness,
    Expression="-(w/2)+y1+g+((w-y1-y2-g)/2)+(Gls/2)")
X_2 = UnitX(Factor=addition_2)
Z_3 = UnitZ(Factor=addition)
neg_3 = Negative(Value=expression_21)
neg_4 = Negative(Value=expression_22)
addition_3 = Addition(A=expression_20, B=door_to_door_gap)
addition_4 = Addition(A=Z_3, B=X_2)
move_3 = Move(Geometry=rectangle_5.Rectangle, Motion=addition_4)  # -> Geometry, Transform
expression_24 = Expression(x=door_jam_y, y=door_jam_recess_y, z=door_jam_recess_y_2, u=inner_face_seal_gap, Expression="(x-y-z-u)")
dom_5 = ConstructDomain(DomainStart=neg_4, DomainEnd=expression_22)
expression_25 = Expression(x=door_jam_y, z=door_jam_recess_y_2, Expression="(x/2)-z")
dom_6 = ConstructDomain(DomainStart=neg_3, DomainEnd=expression_21)
series = Series(Start=0, Step=addition_3, Count=get_integer)
expression_26 = Expression(x=glass_thickness, y=inner_face_seal_gap, Expression="y+x/2")
area = Area(Geometry=move_3.Geometry)  # -> Area, Centroid
xz_3 = XZPlane(Origin=area.Centroid)
rectangle_6 = Rectangle(Plane=xz_3, XSize=dom_5, YSize=dom_6, Radius=0)  # -> Rectangle, Length
Y_2 = UnitY(Factor=expression_25)
X_3 = UnitX(Factor=series)
offset = Offset(Curve=rectangle_6.Rectangle, Distance=glass_frame_inset, Plane=PlaneXY(0, 0, 0), Corners=1)
Y_3 = UnitY(Factor=expression_24)
Y_4 = UnitY(Factor=expr("-x", expression_24))
move_4 = Move(Geometry=move_3.Geometry, Motion=Y_2)  # -> Geometry, Transform
addition_5 = Addition(A=expression_23, B=glass_frame_wedge_seal_gap)
offset_2 = Offset(Curve=offset, Distance=glass_frame_clearance, Plane=PlaneXY(0, 0, 0), Corners=1)
expression_27 = Expression(x=glass_thickness, y=glass_frame_wedge_seal_gap, Expression="x+2*y")
move_5 = Move(Geometry=rectangle_6.Rectangle, Motion=Y_3)  # -> Geometry, Transform
Y_5 = UnitY(Factor=expression_23)
Y_6 = UnitY(Factor=expr("-x", glass_thickness))
move_6 = Move(Geometry=offset, Motion=Y_5)  # -> Geometry, Transform
extr_5 = Extrude(Base=move_4.Geometry, Direction=Y_4)
extr_6 = Extrude(Base=move_5.Geometry, Direction=expr("x*2", Y_4))
Y_7 = UnitY(Factor=addition_5)
Y_8 = UnitY(Factor=expr("-x", expression_27))
extr_7 = Extrude(Base=move_6.Geometry, Direction=Y_6)
move_7 = Move(Geometry=offset_2, Motion=Y_7)  # -> Geometry, Transform
cap_5 = CapHoles(Brep=extr_6)
cap_6 = CapHoles(Brep=extr_5)
cap_7 = CapHoles(Brep=extr_7)
extr_8 = Extrude(Base=move_7.Geometry, Direction=Y_8)
sdiff_5 = SolidDifference(BrepsA=cap_6, BrepsB=cap_5)
pt_12 = ConstructPoint(XCoordinate=expr("-x", Slider(500, range=0..1000)), YCoordinate=0, ZCoordinate=0)
cap_8 = CapHoles(Brep=extr_8)
sdiff_6 = SolidDifference(BrepsA=sdiff_5, BrepsB=cap_8)
yz_3 = YZPlane(Origin=pt_12)
sec = BrepPlane(Brep=sdiff_6, Plane=xy_5)  # -> Curves, Points
sec_2 = BrepPlane(Brep=sdiff_6, Plane=yz_3)  # -> Curves, Points
item_2 = ListItem(List=sec.Curves, Index=0, Wrap=True)  # -> Item, Item1
item_3 = ListItem(List=sec_2.Curves, Index=0, Wrap=True)  # -> Item, Item1
move_8 = Move(Geometry=sdiff_6, Motion=X_3)  # -> Geometry, Transform
move_9 = Move(Geometry=cap_7, Motion=X_3)  # -> Geometry, Transform

# ----
geo = Geometry([move_9.Geometry, move_8.Geometry])
geo_2 = Geometry([mirror_3.Geometry, mirror_4.Geometry, sdiff_4, sdiff_3])
mesh = MeshBrep(
    Brep=[geo_2, geo],
    Settings={GridMaxCount=0, GridMinCount=16, JaggedSeams=False, MaxEdgeLength=0, MinEdgeLength=0.0001, MinTolerance=0, Refine=True, RefineAngle=0, RelativeTolerance=0.65, SimplePlanes=True, Tolerance=0})  # -> flatten(Mesh)
mesh_2 = Mesh(mesh)
context_bake = ContextBake(Geometry=mesh_2)
